# Grasshopper definition animation_piton.ghx (Grasshopper 1.0.7)

toggle = BooleanToggle(True)
timer = Timer(TimerInterval=60, Target=c_script)
c_script = CSharpScript(reset=toggle)  # -> out, B, C, state; inputs reset: Boolean
# ---------- c_script: C# usings ----------
using System.IO;
using System.Linq;
using System.Data;
using System.Drawing;
using System.Reflection;
using System.Windows.Forms;
using System.Xml;
using System.Xml.Linq;
using System.Runtime.InteropServices;

using Rhino.DocObjects;
using Rhino.Collections;
using GH_IO;
using GH_IO.Serialization;
# ---------- c_script: C# ----------
    if(!reset){
      c++;
    }else{
      c = -1;
    }
    c = (int) (c % (201));
    if(c <= 200){
      B = true;
    }else{
      B = false;
    }


    C = c;
    if(!reset)
    {
      state = 1;
    }
    else
    {
      state = 0;
    }
# ---------- c_script: C# additional code ----------
  int c = -1;
# ---------- end c_script ----------
initial_location = Point(Point(2.406673932, 0.7408712059, 0))
initial_state = Integer(0)
rec = Rectangle({Plane=PlaneXY(5.7305638, 3.055329301, 0), Size=Domain2(u=-6.144413036..6.144413036, v=-3.422617341..3.422617341)})
python = GhPythonScript(agentPos=initial_location, initialState=initial_state, reset=toggle)  # -> agentList; inputs agentPos: list of Point3d, initialState: list of Int32, reset: Boolean
# ---------- python: Python ----------
from ghpythonlib.componentbase import executingcomponent as component
import Grasshopper, GhPython
import System
import Rhino
import rhinoscriptsyntax as rs
import sys
import itertools
from Rhino.Geometry import Point3d

cFPath = ghenv.Component.OnPingDocument().FilePath
cpath = cFPath[0:cFPath.rfind('\\')+1]
my_path = cpath+'..\source'
if not my_path in sys.path:
    sys.path.append(my_path)

import Agent
Agent = reload(Agent)

class MyComponent(component):
    def __init__(self):
        self.isRun = False
        self.agentList = None
        self.isAgentInitialized = False
        
    def InitalizeAgent(self, agentPos,initialState):
        self.agentList = []
        for index,(pos,state) in enumerate(itertools.izip_longest(agentPos,initialState)):
            #agent = Agent(pos)
            if index < len(agentPos):
                tState = Agent.STATE_IDLE
                if index < len(initialState):
                    tState = state
                #print pos
                agent = Agent.Agent(pos,Point3d(0,0,0),state)
                self.agentList.append(agent)
                print agent.pos
        self.isAgentInitialized = True
        
    def RunScript(self, agentPos, initialState, reset):
        print reset
        if reset:
            self.isAgentInitialized = False
            return None
            
        if (not self.isRun) and (not reset):
            self.isRun = True
            self.agentList = None
            
        if not self.isAgentInitialized:
            self.InitalizeAgent(agentPos, initialState)
        """Provides a scripting component.
            Inputs:
                x: The x script variable
                y: The y script variable
            Output:
                a: The a output variable"""
        
        __author__ = "remote"
        __version__ = "2020.03.24"
        
        import rhinoscriptsyntax as rs
        
        #for index,(pos,state) in enumerate(itertools.izip_longest(agentPos,initialState)):
            #agent = Agent(pos)
            #if index < len(agentPos):
                #tState = Agent.STATE_IDLE
                #if index < len(initialState):
                    #tState = state
                #print pos
                #agent = Agent.Agent(pos,Point3d(0,0,0),state)
                #agentList.append(agent)
        
        # return outputs if you have them; here I try it for you:
        return self.agentList
# ---------- end python ----------
python_2 = GhPythonScript(area=rec, counter=c_script.C, reset=toggle)  # -> gridArea, topPos, posibleTarget, entryPoints, additionalWeight; inputs counter: Int32, reset: Boolean
# ---------- python_2: Python ----------
from ghpythonlib.componentbase import executingcomponent as component
import Grasshopper, GhPython
import System
import Rhino as rh
import rhinoscriptsyntax as rs
import scriptcontext as sc
import math
import Rhino.Geometry as rg
import sys
from Rhino.Geometry import Point3d,Point

cFPath = ghenv.Component.OnPingDocument().FilePath
cpath = cFPath[0:cFPath.rfind('\\')+1]
my_path = cpath+'..\source'
if not my_path in sys.path:
    sys.path.append(my_path)

import Target
Target = reload(Target)

import Agent
Agent = reload(Agent)

import EntryPoint
EntryPoint = reload(EntryPoint)

STATE_FREE = 0
STATE_BLOCKED = 1
STATE_ENTRY = 2

NEIGHBOR_CHECK = [
    [-1,0],
    [-1,1],
    [0,1],
    [1,1],
    [1,0],
    [1,-1],
    [0,-1],
    [-1,-1],
    [-2,0],
    [-2,1],
    [-2,2],
    [-1,2],
    [0,2],
    [1,2],
    [2,2],
    [2,1],
    [2,0],
    [2,-1],
    [2,-2],
    [1,-2],
    [0,-2],
    [-1,-2],
    [-2,-2],
    [-2,-1]
    ]

class MyComponent(component):
    
    def __init__(self):
        self.gridSize = 0.1
        self.grids = None
        self.gridInitialized = False
        self.topPos = None
        self.possibleTarget = []
        self.entryPoint = []
        self.isRun = False
        self.additionalWeight = None
        
    def InitializeGrid(self,area):
        import rhinoscriptsyntax as rs
        
        entryPointObject = []
        targetPointObject = []
        
        #get nurbscurve or rectangle
        rectArea = rs.coercecurve(area)
        
        if rectArea.Points[0].Location[0] < rectArea.Points[2].Location[0]:
            minX = rectArea.Points[0].Location[0]
            maxX = rectArea.Points[2].Location[0]
        else:
            minX = rectArea.Points[2].Location[0]
            maxX = rectArea.Points[0].Location[0]
        
        if rectArea.Points[0].Location[1] < rectArea.Points[2].Location[1]:
            minY = rectArea.Points[0].Location[1]
            maxY = rectArea.Points[2].Location[1]
        else:
            minY = rectArea.Points[2].Location[1]
            maxY = rectArea.Points[0].Location[1]
        
        #get width/height of the area and gridCount
        """diffW"""
        gridCountW = abs(int(math.ceil(maxX/self.gridSize)) - int(math.floor(minX/self.gridSize)))
        #gridCountW =  int(math.ceil(abs(diffW)/self.gridSize))
        
        #diffH = rectArea.Points[0].Location[1] - rectArea.Points[2].Location[1]
        gridCountH = abs(int(math.ceil(maxY/self.gridSize)) - int(math.floor(minY/self.gridSize)))
        #gridCountH =  int(math.ceil(abs(diffH)/self.gridSize))
        
        #initialize grid array
        self.grids = [[STATE_FREE for i in range(gridCountH)]for j in range(gridCountW)]
        self.additionalWeight = [[0 for i in range(gridCountH)]for j in range(gridCountW)]
        
        gridStartX = float(math.floor(minX/self.gridSize)) * self.gridSize
        gridStartY = float(math.ceil(maxY/self.gridSize)) * self.gridSize
                
        if rectArea:
            
            #get objects inside the region
            rc,pl = rectArea.TryGetPolyline()
            view = sc.doc.Views.ActiveView.ActiveViewport            
            objectList = rh.RhinoDoc.ActiveDoc.Objects.FindByCrossingWindowRegion(view,pl,True,rh.DocObjects.ObjectType.Curve|rh.DocObjects.ObjectType.Point)
            
            rh.DocObjects.RhinoObject.ObjectType
            
            #print "gourd"
            for oi in objectList:
                #print oi.Id
                #rs.
                #rh.DocObjects.ObjectType.AnyObject.Curve(
                #print rs.GetUserText(oi,"chair")
                #print rs.GetUserText(oi,"Entry")
                #print rs.GetUserText(oi,"Target")
                if oi.ObjectType == rh.DocObjects.ObjectType.Point:
                    #pp = rh.DocObjects.PointObject.PointGeometry
                    #pp = oi.PointGeometry
                    #pr = rh.Geometry.Point.Location
                    #pr = pp.Location
                    #print (pp.GetType())
                    #print pp
                    #print pr
                    if rs.GetUserText(oi,"Target") != None:
                        target = Target.Target(oi.PointGeometry.Location)
                        targetPointObject.append(oi)
                        self.possibleTarget.append(target)
                    if rs.GetUserText(oi,"Entry") != None:
                        entryPointObject.append(oi)
                        self.entryPoint.append(EntryPoint.EntryPoint(oi.PointGeometry.Location))
                    continue
                curve = oi.CurveGeometry
                if not curve:
                    continue
                bbox = curve.GetBoundingBox(True)
                if not bbox.IsValid: continue

                #print "World min:", bbox.Min
                #print "World max:", bbox.Max
                
                xMin = int(((float(math.floor(bbox.Min.X/self.gridSize)) * self.gridSize) - gridStartX)/self.gridSize)
                xMax = int(((float(math.ceil(bbox.Max.X/self.gridSize)) * self.gridSize) - gridStartX)/self.gridSize)
                #rh.DocObjects.CurveObject.Geometry.
                yMin = int((gridStartY - (float(math.floor(bbox.Min.Y/self.gridSize)) * self.gridSize))/self.gridSize)
                yMax = int((gridStartY - (float(math.ceil(bbox.Max.Y/self.gridSize)) * self.gridSize))/self.gridSize)
            
                for i in range(yMax,yMin+1):
                    for j in range(xMin,xMax+1):
                    #rg.Rectangle3d.
                        cRect = rh.Geometry.Rectangle3d(rh.Geometry.Plane.WorldXY,rg.Point3d(gridStartX+(j*self.gridSize),gridStartY-(i*self.gridSize),0),rg.Point3d(gridStartX+((j+1)*self.gridSize),gridStartY-((i+1)*self.gridSize),0))
                    #cRect = rh.Geometry.Rectangle3d(rh.Geometry.Plane.WorldXY,rg.Point3d(rectArea.Points[0].Location[0]+(j*self.gridSize),rectArea.Points[0].Location[0]+(i*self.gridSize),0),rg.Point3d(rectArea.Points[0].Location[0]+((j+1)*self.gridSize),rectArea.Points[0].Location[0]+((i+1)*self.gridSize),0))
                        #print cRect.Area
                    #for oi in objectList:
                        #if oi.ObjectType == rh.DocObjects.ObjectType.Point:
                            #continue
                        inter = rg.Intersect.Intersection.CurveCurve(oi.CurveGeometry,cRect.ToNurbsCurve(),0,0)
                        if inter:
                            self.grids[j][i] = STATE_BLOCKED
        for ep in self.entryPoint:
            gridEpX = int(math.floor((ep.pos.X - gridStartX)/self.gridSize))
            gridEpY = int(math.floor((gridStartY - ep.pos.Y)/self.gridSize))
            
            self.grids[gridEpX][gridEpY] = STATE_ENTRY
            """print ep
            print str(gridEpX)+" "+str(gridEpY)
            print str(len(self.grids))+" "+str(len(self.grids[0]))
            
            for fGrid in [(0, -1), (0, 1), (-1, 0), (1, 0), (-1, -1), (-1, 1), (1, -1), (1, 1)]:
                self.grids[gridEpX+fGrid[0]][gridEpY+fGrid[1]] = STATE_FREE"""
            print "aaaaaa"
            for (epObject,ep) in zip(entryPointObject,self.entryPoint):
                epGroupList = epObject.GetGroupList()
                #print epGroupList
                for (tObject,target) in zip(targetPointObject,self.possibleTarget):
                    targetGroupList = tObject.GetGroupList()
                    #print "taget"
                    #print target.targetPoint
                    #print targetGroupList
                    counter = 0
                    #target and entry point must have all their group similar
                    for tGroup in targetGroupList:
                        #print "tiger "+str(tGroup)
                        for eGroup in epGroupList:
                            #print "eger "+str(eGroup)
                            if tGroup == eGroup:
                                counter +=1
                                break
                    if counter == len(targetGroupList):
                        ep.target = target
                        break
                print "entrrar"
                print ep.pos
                print ep.target
            
            print "done dion"
            
        for tgt in self.possibleTarget:
            print tgt.targetPoint
        
        print len(self.grids[0])
        print len(self.grids)
        print gridCountH
        print gridCountW
        
        for i in range(len(self.grids[0])):
            for j in range(len(self.grids)):
                for neighbor in NEIGHBOR_CHECK:
                    toCheckX = i + neighbor[0]
                    toCheckY = j + neighbor[1]
                    
                    #out of area
                    if (toCheckX < 0) or (toCheckX >= gridCountH) or (toCheckY < 0) or (toCheckY >= gridCountW):
                        continue
                    
                    #wall
                    if self.grids[j][i] == STATE_BLOCKED:
                        continue
                    
                    #already checked
                    #if self.additionalWeight[j][i] > 0:
                        #continue
                        
                    if self.grids[toCheckY][toCheckX] == STATE_BLOCKED:
                        self.additionalWeight[j][i] = max(abs(neighbor[0]),abs(neighbor[1])) * self.gridSize * 100
                    
        print "maze"
        for i in range(len(self.grids[0])):
            s = ""
            for j in range(len(self.grids)):
                s+=(str(self.grids[j][len(self.grids[0]) - i -1])+" ")
            print s
        print "weight"
        for i in range(len(self.grids[0])):
            s = ""
            for j in range(len(self.grids)):
                s+=(str(self.additionalWeight[j][len(self.additionalWeight[0]) - i -1])+" ")
            print s
        self.gridInitialized = True
            
        self.topPos = Point3d(gridStartX,gridStartY,0)
    
    def RunScript(self, area,counter,reset):
        gridArea = None
        topPos = None
        entryPoints = None
        """Provides a scripting component.
            Inputs:
                x: The x script variable
                y: The y script variable
            Output:
                a: The a output variable"""
        
        __author__ = "andri.setiawan"
        __version__ = "2020.03.16"
        
        
        import rhinoscriptsyntax as rs
        import sys
        
        if reset:
            self.gridInitialized = False
            self.isRun = False
            return None,None,None
        
        if (not self.isRun) and (not reset):
            self.isRun = True
            self.grids = None
            self.gridInitialized = False
            self.topPos = None
            self.possibleTarget = []
            self.entryPoint = []
            
        
        if not self.gridInitialized:
            self.InitializeGrid(area)
        
        """
        rectArea = rs.coercecurve(area)
        
        #gridDim1 = rectArea.Points[0][0] - rectArea.Points[2][0]
        
        #dd = rh.Geometry.ControlPoint.Location.
        diffW = rectArea.Points[0].Location[0] - rectArea.Points[2].Location[0]
        gridCountW =  int(math.ceil(abs(diffW)/self.gridSize))
        
        diffH = rectArea.Points[0].Location[1] - rectArea.Points[2].Location[1]
        gridCountH =  int(math.ceil(abs(diffH)/self.gridSize))
        
        
        print("grid count %d %d"%(gridCountW,gridCountH))
        
        self.grids = [[STATE_FREE for i in range(gridCountW)]for j in range(gridCountH)]
        
        if rectArea:
            rc,pl = rectArea.TryGetPolyline()
            view = sc.doc.Views.ActiveView.ActiveViewport
            
            objectList = rh.RhinoDoc.ActiveDoc.Objects.FindByCrossingWindowRegion(view,pl,True,rh.DocObjects.ObjectType.Curve)
            i = 0
            for oi in objectList:
                print "ojepk %d gu %s is %s" %(i,oi, oi.GetType())
                #rh.DocObjects.CurveObject.
                print oi.CurveGeometry
                objj  = oi.CurveGeometry.GetType()
                
                #rh.Geometry.Rectangle3d(
                
                #if objj == rh.Geometry.LineCurve:
                    #print oi.CurveGeometry.PointAtStart
                    #print oi.CurveGeometry.PointAtEnd
                    #for i in range(len(self.grids)):
                        #for j in range(len(self.grids[i])):
                            #rg.Rectangle3d.
                            #cRect = rh.Geometry.Rectangle3d(rh.Geometry.Plane.WorldXY,rg.Point3d(rectArea.Points[0].Location[0]+(i*self.gridSize),rectArea.Points[0].Location[0]+(j*self.gridSize),0),rg.Point3d(rectArea.Points[0].Location[0]+((i+1)*self.gridSize),rectArea.Points[0].Location[0]+((j+1)*self.gridSize),0))
                            #print cRect.Area
                            #inter = rg.Intersect.Intersection.CurveCurve(oi.CurveGeometry,cRect.ToNurbsCurve(),0.1,0)
                            #if inter:
                                #self.grids[i][j] = STATE_BLOCKED
                        #print self.grids[i]
                #else:
                    #obb=oi.CurveGeometry.Points
                    #for po in obb:
                        #print po.Location
                for i in range(len(self.grids)):
                    for j in range(len(self.grids[i])):
                        #rg.Rectangle3d.
                        cRect = rh.Geometry.Rectangle3d(rh.Geometry.Plane.WorldXY,rg.Point3d(rectArea.Points[0].Location[0]+(i*self.gridSize),rectArea.Points[0].Location[0]+(j*self.gridSize),0),rg.Point3d(rectArea.Points[0].Location[0]+((i+1)*self.gridSize),rectArea.Points[0].Location[0]+((j+1)*self.gridSize),0))
                        #print cRect.Area
                        inter = rg.Intersect.Intersection.CurveCurve(oi.CurveGeometry,cRect.ToNurbsCurve(),0.1,0)
                        if inter:
                            self.grids[i][j] = STATE_BLOCKED
                #print obb
                #crv = rs.coercecurve(oi.Id)
                #print crv
                #if crv:
                    #print crv.GetType()
                #print od
                i+=1
            for i in range(len(self.grids)):
                print self.grids[i]
        """
        # return outputs if you have them; here I try it for you:
        gridArea = self.grids
        topPos = self.topPos
        possibleTarget = self.possibleTarget
        entryPoints = self.entryPoint
        additionalWeight = self.additionalWeight
        return gridArea,topPos,possibleTarget,entryPoints,additionalWeight
# ---------- end python_2 ----------
pf_test_unit = GhPythonScript()  # -> a; inputs grids: list, additionalWeight: list, topPos: Point3d
# ---------- pf_test_unit: Python ----------
from ghpythonlib.componentbase import executingcomponent as component
import Grasshopper, GhPython
import System
import Rhino
import rhinoscriptsyntax as rs
import sys

cFPath = ghenv.Component.OnPingDocument().FilePath
print cFPath
cpath = cFPath[0:cFPath.rfind('\\')+1]
print cpath
my_path = cpath+'..\source'
if not my_path in sys.path:
    sys.path.append(my_path)

import PathFinding
PathFinding = reload(PathFinding)

class MyComponent(component):
    
    def RunScript(self, grids, additionalWeight, topPos):
        a = None
        PathFinding.Map.maze = grids
        PathFinding.Map.topPos = topPos
        PathFinding.Map.additionalWeight = additionalWeight
        """Provides a scripting component.
            Inputs:
                x: The x script variable
                y: The y script variable
            Output:
                a: The a output variable"""
        
        __author__ = "remote"
        __version__ = "2020.04.16"
        
        import rhinoscriptsyntax as rs
        PathFinding.astarv2((117,47),(35,41))#,(76,29))
        # return outputs if you have them; here I try it for you:
        return a
# ---------- end pf_test_unit ----------
python_3 = GhPythonScript(
    mArea=python_2.gridArea,
    agent=python,
    topPos=python_2.topPos,
    possibleTarget=python_2.posibleTarget,
    entryPoints=python_2.entryPoints,
    additionalWeight=python_2.additionalWeight)  # -> a; inputs mArea: list, agent: list, topPos: Point3d, possibleTarget: list, entryPoints: list, additionalWeight: list
# ---------- python_3: Python ----------
from ghpythonlib.componentbase import executingcomponent as component
import Grasshopper, GhPython
import System
import Rhino
import rhinoscriptsyntax as rs
import sys
from Rhino.Geometry import Point3d
import math

cFPath = ghenv.Component.OnPingDocument().FilePath
print cFPath
cpath = cFPath[0:cFPath.rfind('\\')+1]
print cpath
my_path = cpath+'..\source'
if not my_path in sys.path:
    sys.path.append(my_path)

import Agent
Agent = reload(Agent)

import PathFinding
PathFinding = reload(PathFinding)

class MyComponent(component):
    def __init__(self):
        self.haveAgentList = False
        self.myAgent = None
        self.s = 0
        self.pointScreen = []
    
    def RunScript(self, mArea, agent,topPos,possibleTarget,entryPoints,additionalWeight):
        import Agent
        Agent = reload(Agent)
        PathFinding.Map.topPos = topPos
        PathFinding.Map.additionalWeight = additionalWeight
        print PathFinding.Map.topPos
        if not agent[0]:
            print "no agent"
            self.pointScreen = []
            self.myAgent = []
            return
        elif len(self.pointScreen) == 0:
            for i in range(len(agent)):
                point = Point3d(0,0,0)
                self.pointScreen.append(point)
        a = None
        """Provides a scripting component.
            Inputs:
                x: The x script variable
                y: The y script variable
            Output:
                a: The a output variable"""
        if not self.myAgent:
            self.myAgent = agent
        PathFinding.Map.maze = mArea
        
        __author__ = "andri.setiawan"
        __version__ = "2020.03.21"
        
        import rhinoscriptsyntax as rs
        
        #if Agent.Agent.possibleTarget == None:
        Agent.Agent.possibleTarget = possibleTarget
        Agent.Agent.entryPointList = entryPoints
        #for tgt in possibleTarget:
            #print tgt
            #print tgt.targetPoint
        print len(Agent.Agent.possibleTarget)
        i = 0
        for agt in self.myAgent:
            if agt.target != None:
                print agt.target.targetPoint
            #print agt.state
            pos = agt.update()
            
            self.pointScreen[i].X = pos.X
            self.pointScreen[i].Y = pos.Y
            self.pointScreen[i].Z = pos.Z
            i+=1
            #if agt.state != 0:
                #print agt.myPath
            #print str(agt.state)+ " "+str(agt.waitTime)
            #print agt.pos
        #px,py = TranslateToGridPos(topPos,agent[0].pos)
        
        print self.s
        self.s+=1
        #print py
        # return outputs if you have them; here I try it for you:
        a = self.pointScreen
        return a

def TranslateToGridPos(topPos,pos):
    #print topPos
    #print pos
    gridX = int(math.ceil((pos.X - topPos.X)/0.1))
    gridY = int(math.ceil((topPos.Y - pos.Y)/0.1))
    return gridX,gridY
# ---------- end python_3 ----------
